% Simulink data dictionary SiDLEngine.sldd

PlntEngNeuralODE = struct(
  model=struct(
    fc1=struct(
      Weights=[0.1137106 0.6685827 -0.2150549 0.1692235 -0.496642 0.116263 0.4939185 0.79915 1.25487 0.199402 1.218193 -0.1364674 0.1470796 -0.4733217 -0.8754748 -0.8235729
       -0.3609486 0.1943155 -0.1440458 0.3017965 -0.05961579 0.7712496 2.16298 1.836017 -1.549477 -0.812404 0.1164112 -0.08636362 -0.05913834 0.3761402 0.1363866 -0.02235059
       -1.069062 0.6397353 0.2599509 4.082581 -0.08041427 -0.8555598 0.3629556 0.6063789 1.114548 0.216184 0.303208 1.772633 -0.1467283 0.1518415 -0.0379214 0.1010245
       -0.3547737 1.372217 -0.4348964 1.28611 -0.3235005 0.2810576 0.1682794 0.8548034 0.2883975 -0.04230814 -0.2900876 0.5296184 -0.3302214 -0.2464265 -0.3323311 -0.9226114
       -0.8918817 0.1207526 0.01286489 0.3853518 -0.3502131 1.084759 0.3830396 1.691744 0.790266 -1.419843 -0.09223526 -0.6121153 -0.7777783 0.03772186 -0.5276655 -0.2095517
       -0.166408 0.5674968 0.7260643 0.7125828 -0.6593191 0.5809829 -1.271408 -0.1046926 0.2401256 2.225359 0.3652045 -0.5908256 -0.7788239 0.1438638 -0.05417449 0.1934908
       0.4591369 0.1899102 -0.3521345 -0.2806439 -0.3505188 0.1817264 -0.02849922 0.1909329 0.05758545 -0.159123 -0.01752665 0.05046619 -0.2041075 -0.05629832 -0.09923262 3.314297
       -1.498795 0.1394699 1.042268 0.2199504 -0.02142257 -1.553101 0.7984011 1.331948 0.2325914 0.6538619 -0.1354137 -5.122523 0.1011159 -0.1578342 -0.02549396 -0.07713298
       -1.071639 0.07027897 -0.1110087 -0.3825589 0.9424145 0.36245 1.027342 0.1470325 -1.524006 -0.6736322 -0.1133701 -0.8516923 -0.2641622 0.04838157 -0.07157802 0.1225893
       -1.913497 0.4512865 -1.644723 -0.6822759 0.7435323 1.439771 0.6112392 -0.1466533 0.5085574 -0.155676 0.4582064 -2.689261 -0.4034171 0.1570593 0.02452318 -0.02850044
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       ],
      Bias=[-1.33508; 0.529664; -3.505419; -1.263465; -1.141093; -0.8970729; -3.800365; -3.893399; -3.160683; 1.342297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 0.03058249]),
    fc2=struct(
      Weights=[-0.09298052 0.1249369 0.1157234 -0.1054504 -0.1383796 -0.2131056 -0.4397698 -0.03145208 -0.07709642 -0.1457354 0.1761642 -0.1275568 0.2693802 0.1683711 -0.2768352 -0.1272763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
       3.366134e-08 1.163108e-07 3.081301e-06 -1.096358e-07 4.21004e-08 5.799067e-06 9.910001e-08 7.145632e-08 -4.430161e-07 -7.600838e-07 5.847468e-08 -5.456793e-08 9.053989e-06 -9.092997e-08 3.508783e-08 -8.011696e-09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
       -0.243876 -0.3161286 -0.4265186 -0.2902052 0.05116994 0.1325319 0.6662218 -0.1095261 -0.3107764 1.881828 -0.9812879 -0.3905623 -0.1548946 -0.03012029 -0.1663411 -0.3060966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
       -1.674179e-06 2.509805e-07 2.438179e-07 -6.839626e-06 9.073693e-08 4.227865e-06 1.259554e-07 8.777145e-08 -4.771741e-08 -3.017885e-08 1.517125e-07 -7.360227e-08 -1.991237e-08 -2.456554e-08 -7.25362e-08 8.215547e-06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
       -0.0255898 0.08616082 0.09727018 0.02228484 -0.01414222 -0.04449071 -0.262049 0.02201093 -0.03029781 -0.2239752 0.2492034 -0.1099223 0.09761202 0.2210515 0.0009008111 -0.095231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
       -0.07884373 0.348023 -0.2726279 -0.5241346 0.1888773 0.5272038 0.08947795 -0.06324411 0.2389082 -1.082245 -0.1255133 -0.5332283 0.3457075 0.09526551 0.5318462 1.57773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
       0.1547676 0.01116609 -0.5266414 -0.05786647 0.03359695 0.1093298 -0.2132483 -0.06338339 -0.07464489 -0.4588384 -0.2972838 -0.3871602 -0.1389706 0.1023496 -0.09432822 -0.1256707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
       0.05037542 -0.2321476 0.9550522 0.1931312 0.04070267 -0.419685 0.02543833 0.006216967 -0.03790971 -0.02977859 0.7591314 0.1385557 -0.2438223 0.6870787 -0.1768007 -0.3902709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
       0.3261211 0.3727536 0.402043 0.1229815 -0.5011483 -0.1480583 -0.05386387 -0.1991256 -0.2193858 0.05860608 0.0787129 -0.3346543 0.2539645 0.0938862 -0.3478667 0.0148923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
       0.1388206 0.001998226 -0.4073029 0.4698217 0.004344522 0.2659851 -0.4372626 0.03296255 -0.06799811 -0.713421 0.3452447 -0.3845039 -0.1189206 -0.09756652 -0.02941896 1.066121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       ],
      Bias=[-2.273894; -16.58414; -1.155179; -16.57707; -4.89254; -1.521743; -0.6989202; -2.352734; -2.587178; -1.341386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 1.165243]),
    fc3=struct(
      Weights=[0.4369517 2.41137e-05 -0.5985427 3.116665e-05 0.1512939 -2.057326 -0.5596788 -3.642786 -0.9566978 -2.022071 -0.8819067 1.447932 0.7422061 -2.226397 1.249681 -1.438978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
       0.3315447 0.0005235314 -1.846399 0.0005286016 -0.2312459 -1.607624 0.07364571 -3.731893 -1.142783 -3.086582 0.7861606 2.456195 -0.1643039 -1.957863 1.136952 -1.34758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
       0.59896 -0.0002050467 0.1991185 -0.0002052014 0.2803372 -4.143121 0.7859039 1.581513 1.015671 -2.662103 1.074699 1.272058 0.9988366 -0.02416265 0.5206969 0.4470215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
       0.1465622 7.344397e-05 -3.082457 7.258488e-05 0.4942759 -0.3585566 -0.1985084 -0.326099 0.443851 -0.02251471 1.023506 1.017254 -0.1143677 0.7189927 0.04533437 2.449542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
       0.04589856 -1.335273e-05 0.6145171 -1.281842e-05 -0.7483231 -1.029994 0.7404566 0.4505653 1.22433 0.4158229 -1.103336 0.2172437 1.186736 -0.9790602 -1.26443 -0.1471956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
       0.07953947 5.552511e-06 -0.2758367 6.59631e-06 0.4937139 -0.5863501 -0.3026828 0.2461344 0.2322165 -0.8242156 1.528842 1.465254 2.799073 -0.2201435 0.09931192 -4.134118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
       -0.9472436 -0.0002490149 0.4846762 -0.0002533336 -0.8198084 1.306768 -0.3684353 -0.9613228 -0.7407957 1.51348 -2.135523 -1.368088 -1.729229 0.9971647 -0.3624521 -0.6340213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
       0.1206474 2.209202e-05 0.4371397 2.362809e-05 -0.6137699 0.191129 0.2544553 0.6718459 -0.1767244 0.01071453 -1.303102 0.2525626 -0.3230642 -0.2757462 -0.04830401 1.686978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
       -0.2664765 0.0001604341 1.612314 0.0001598104 -0.3168602 -0.6337162 0.5279314 0.4637375 -0.06366288 0.4859825 0.3226674 -0.7339968 -0.5894264 0.120247 0.3206784 0.6614633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       ],
      Bias=[-0.130181; 0.8411428; -0.1787704; -0.09766036; 0.5118585; 0.8203106; 0.09172918; -1.007083; -0.1383934]),
    numFullyConnectedLayers=3,
    actfun="sigmoid"),
  trainingOptions=struct(
    dataPreProcessingOptions=struct(
      smoothData=true,
      smoothingWindowSize=10,
      downsampleData=true,
      downsampleRatio=10,
      standardizeData=true,
      addDithering=false,
      ditheringNoiseLevel=0.001),
    useAugmentation=true,
    augmentationSize=5,
    useTappedDelay=false,
    inputDelays=[1 2 3 4],
    outputDelays=[],
    initialLearnRate=0.01,
    learnRateDropFactor=0.99,
    learnRateDropPeriod=1,
    l2Regularization=0.0001,
    gradientThresholdMethod="global-l2norm",
    gradientThreshold=2,
    miniBatchSize=128,
    maxEpochs=150,
    timeLimit=43200,
    hiddenUnits=100,
    numFullyConnectedLayers=3,
    actfunName="sigmoid",
    Ts=0.1,
    numObservations=149045,
    tspan=[0 0.1 0.2 0.3 0.4 0.5 0.6 0.7 0.8 0.9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 6],
    numTimesPerObs=61,
    nu=7,
    nx=4,
    ny=9,
    nin=7,
    nout=4),
  data=struct(
    U0=[],
    Y0=[-1.164696; -1.855994; -0.3065278; -5.851228],
    muU=[36.36645 51.75941 2788.255 39.21437 24.95584 -4.998855 0.8500392],
    muY=[0.04174419 114.9707 120634.2 1054.593],
    sigU=[32.42704 26.76493 1775.046 26.57868 14.40891 2.887041 0.08640107],
    sigY=[0.03584126 61.94564 62993.19 130.1339],
    nin=7,
    nout=4,
    nu=7,
    nx=4,
    ny=9,
    weights=[1 1.00488 1.009761 1.014641 1.019522 1.024402 1.029283 1.034163 1.039043 1.043924 1.048804 1.053685 1.058565 1.063446 1.068326 1.073206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
     1 1.00488 1.009761 1.014641 1.019522 1.024402 1.029283 1.034163 1.039043 1.043924 1.048804 1.053685 1.058565 1.063446 1.068326 1.073206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
     1 1.00488 1.009761 1.014641 1.019522 1.024402 1.029283 1.034163 1.039043 1.043924 1.048804 1.053685 1.058565 1.063446 1.068326 1.073206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
     1 1.00488 1.009761 1.014641 1.019522 1.024402 1.029283 1.034163 1.039043 1.043924 1.048804 1.053685 1.058565 1.063446 1.068326 1.073206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     ]))

PlntEngSIDLVd = Simulink.Parameter(0.0015)
PlntEngSIDLNCyl = Simulink.Parameter(4)
PlntEngSIDLAccPwrTbl = Simulink.Parameter([0 0], DataType="double")
PlntEngSIDLAccSpdBpt = Simulink.Parameter([300 750], DataType="double")
PlntEngSIDLTimeCETC = Simulink.Parameter(0.085, DataType="double")
PlntEngSIDLTimeCVGT = Simulink.Parameter(0.15, DataType="double")
PlntEngSIDLEngineType = [1 2 3 4 5 6 7]