% Simulink data dictionary Battery.sldd

BattCapInit = 3.18
BattChargeMax = 5.3
BattTempBp = [243.1 253.1 263.1 273.1 283.1 298.1 313.1]
CapLUTBp = [0 0.01 0.02 0.03 0.04 0.05 0.06 0.07 0.08 0.09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 1]
CapSOCBp = [0 0.2 0.4 0.6 0.8 1]
eff = 98
Em = [2.8 3.228 3.284 3.361 3.408 3.427 3.472 3.477 3.493 3.504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 4.221]
Np = 1
Ns = 72

RInt = [0.008846 0.009319 0.009027 0.00847 0.01032 0.01314
 0.006389 0.006554 0.005553 0.005525 0.006043 0.007805
 0.004364 0.004101 0.00406 0.003452 0.003846 0.004517
 0.002031 0.002563 0.002532 0.00246 0.002716 0.003047
 0.001443 0.001825 0.001795 0.001778 0.001924 0.002234
 0.0005603 0.0007192 0.0006887 0.0007557 0.0007355 0.001014
 0.001028 0.001338 0.001 0.001536 0.001546 0.002789]

Tc = 0.001
Iafser = 0
Lafser = 0.01
Lser = 0.06
Rser = 0.1
VoltCmd = 24
Vinit = 650
Plimit = 30000
Vinit_Start = 24
Plimit_Start = 5000
BattChrgPwrMax = -30000
BattCurrMax = 150
BattDischrgPwrMax = 46000
eta_dcdc = 0.98