% Simulink data dictionary Driver.sldd

DriverInitialGear = 0
DriverPositionGainR = 0.25
DriverDelayGain = 0.01
DriverYawRateGain = 0.2
DriverPositionGainF = 6
DriverAeroRes = 0.5
DriverPreviewDist = 4
DriverTimeConst = 0.3
DriverDrivelineRes = 10
DriverRollRes = 800
DriverShiftTime = 0.1
DriverTractiveForce = 14000
DriverFrontCornerStiff = 40000
DriverRearCornerStiff = 40000
DriverWheelRange = 1.0472