% Simulink data dictionary Scenario.sldd

ScnLongVelUnit = "mph"
ScnSSSweepTime = 30
ScnDLCGateLongPos = 175
ScnDLCLongRefStartPos = 2
ScnDLCVehicleWidth = 2
ScnISHandwheelRate = 13.5
ScnISLatAccStop = "on"
ScnISMaxLatAccel = 0.5
ScnISSteerHoldTime = 2
ScnSSSteerAmp = 90
ScnSSFinalFreq = 0.7
ScnSDSteerFreq = 0.7
ScnSDSteerAmp = 90
ScnSDDwellTime = 0.5
ScnCRRadius = 100
ScnCRMaxLatAccel = 0.5
ScnCRLatAccStop = "off"
ScnFHSteerSpeed = 720
ScnFHUseRollRate = "off"
ScnFHInitialDwellTime = 0.5
ScnFHCounterDwellTime = 3
ScnFHReturnTime = 2
ScnFHRollRateZeroCross = 1.5
ScnDLCLatRefOffset = 5.7
ScnISMaxHandwheelAng = 270
ScnManType = 1
ScnDLCLongRefBpt = [0 0.185 0.37 0.555 0.74 0.925 1.11 1.295 1.48 1.665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 59.9]
ScnDLCLatRef = [0 0 0 0 0 0 0 0 0 0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 0.1]
ScnFHSteerAmp = 540
ScnStartTime = 2
ScnTimeToStrtDecel = 20
ScnLongVelRef = 35
ScnBrakePedalTime = 20
ScnBrkAx = 0.5
ScnBrkAxdec = 0.5
ScnBrkXbrake = 175
Scn3DFrameRate = 0.03
ScnSteerDir = "Right"